# Grasshopper definition floorplan_generator.gh (Grasshopper 1.0.8)
# plug-ins: Human, FloorPlanGenerator, Grasshopper-Archicad Live Connection built for Rhinoceros 8

# ---- group: USER INPUT
panel = Panel("The client wants a house floor plan with a total area up to 95 m² in Guimarães, Portugal. The house should have a foyer, living room, kitchen, two deposits, corridor, an art studio (almost the same size as living room), library (almost the same size as bedroom), toilet, bedroom, and bathroom. The art studio should get at least 4 hours of sunlight in winter because the client likes spending afternoons there. The bedroom should get at least 2 hours of sunlight in summer. Art studio, library, and bedroom should be in quiet areas since the client prefers calm spaces. The foyer should give access to the living room, toilet, and one of the deposits. The living room connects to the kitchen, library, and corridor. The corridor should link the art studio, which is connected to the other deposit, and bedroom, which is connected to ensuite bathroom. All rooms should have one window for light and ventilation, except for the corridor. The terrain is 25 meters wide and 30 meters long.")

# ---- group: Convert the user text into a machine-readable format
py3 = Python3Script(input_text=panel, run=Toggle(True))  # -> out, out_2
# ---------- py3: Python ----------
import requests

url = 'http://localhost:5000/get_parameters'
payload = {'input': input_text}

out = None
if run:
    try:
        response = requests.post(url, json=payload)
        response.raise_for_status()
        
        # Debug prints
        print("Raw response:", response.text)
        data = response.json()
        print("Parsed JSON:", data)
        print("Response data:", data['response'])
        
        out = str(data['response'])
    except requests.exceptions.RequestException as e:
        out = f"Failed to connect: {str(e)}"

a = out
# ---------- end py3 ----------
panel_2 = Panel(py3.out_2)

# ---- group: Extracting the information as parameters
py3_2 = Python3Script(llm_json=py3.out_2)  # -> out, room_names, room_areas, room_connections, room_windows, room_sun_hours_summer, room_sun_hours_winter, room_noise_level, requested_area
# ---------- py3_2: Python ----------
import ast

# Step 1: Convert the string to a Python dictionary
llm_dict = ast.literal_eval(llm_json)

# Step 2: Now access the data safely
rooms = llm_dict['rooms']
requested_area = llm_dict.get('total_area')

room_names = []
room_areas = []
room_connections = set()
room_windows = []
room_sun_hours_summer = []
room_sun_hours_winter = []
room_noise_level = []

for room in rooms:
    room_type = room['type']
    room_area = room['area']
    connects_to = room['connects_to']  # Already a list now
    room_window = room['window_counts']
    sun_hour_summer = int(room.get('sun_hours_summer', 0) or 0)
    sun_hour_winter = int(room.get('sun_hours_winter', 0) or 0)
    noise_level = room['noise_level']

    room_names.append(room_type)
    room_areas.append(room_area)
    room_windows.append(room_window)
    room_sun_hours_summer.append(sun_hour_summer)
    room_sun_hours_winter.append(sun_hour_winter)
    room_noise_level.append(noise_level)
    room_priority=["laundry", "toilet", "office", "foyer", "deposit"]

    for target in connects_to:
        # Avoid duplicates like A-B and B-A by sorting
        pair = tuple(sorted([room_type, target]))
        item0 = pair[0]
        item1 = pair[1]
        if item1 in room_priority:
            item0 = pair[1]
            item1 = pair[0]
        connection = f"{item0}-{item1}"
        room_connections.add(connection)



 

# Step 3: Output the results to Grasshopper
room_connections = sorted(room_connections)  # Sorted list of unique connections
# ---------- end py3_2 ----------

# ----
rooms = Panel(py3_2.room_names)
area = Panel(py3_2.room_areas)
windows_count = Panel(py3_2.room_windows)
connectivity = Panel(py3_2.room_connections)
sun_hours_summer = Panel(py3_2.room_sun_hours_summer)
requested_area = Panel(py3_2.requested_area)
sun_hours_winter = Panel(py3_2.room_sun_hours_winter)
noise_level = Panel(py3_2.room_noise_level)

# ---- group: Layout options
layout_options = Slider(4, range=0.01..4)

# ----
python_3_script = Python3Script(noise_level=noise_level)  # -> out, output_list; inputs noise_level: list
# ---------- python_3_script: Python ----------
noise_level = noise_level
output_list = ["null" if x is None else x for x in noise_level]
# ---------- end python_3_script ----------
mass_addition = MassAddition(Input=area)  # -> Result, PartialResults
replace_text = ReplaceText(Text=sun_hours_summer, Find="0", Replace="null", RecursiveReplace=False)
replace_text_2 = ReplaceText(Text=sun_hours_winter, Find="0", Replace="null", RecursiveReplace=False)
py3_3 = Python3Script(room_names=rooms, pairs=connectivity)  # -> out, index_pairs; inputs room_names: list, pairs: list
# ---------- py3_3: Python ----------
name_to_index = {name: idx for idx, name in enumerate(room_names)}
print(name_to_index)

index_pairs = []
for pair in pairs:
    room1, room2 = pair.split("-")
    index_pair = str(name_to_index[room1]+1) + "-" + str(name_to_index[room2]+1)
    index_pairs.append(index_pair)
# ---------- end py3_3 ----------
total_area = Panel(mass_addition.Result)
panel_3 = Panel(replace_text)
panel_4 = Panel(replace_text_2)
panel_5 = Panel(python_3_script.output_list)
panel_6 = Panel(py3_3.index_pairs)
py3_4 = Python3Script(room_names=rooms)  # -> out, a; inputs room_names: list
# ---------- py3_4: Python ----------
a = []
for name in room_names:
    if name == "foyer":
        a.append("True")
    else:
        a.append("False")
# ---------- end py3_4 ----------
multiplication = Multiplication(A=layout_options, B="100")
round = Round(Number=multiplication)  # -> Nearest, Floor, Ceiling
panel_7 = Panel(round.Nearest)
vector_xyz = VectorXYZ(XComponent=Slider(-20.46, range=-100..100), YComponent=Slider(30, range=-100..100), ZComponent=0)  # -> Vector, Length
concatenate = Concatenate(FragmentA="LAYOUT OPTION ", FragmentB=panel_7)
py3_5 = Python3Script(llm_json=py3.out_2)  # -> out, building_type, site_location, site_width, site_length, site_setback_front, site_setback_side, site_setback_rear
# ---------- py3_5: Python ----------
import ast

# Step 1: Convert the string to a Python dictionary
llm_dict = ast.literal_eval(llm_json)

# Step 2: Access site-related data
building_type = llm_dict.get('building_type')
site_location = llm_dict.get('site_location')

# Handle nested site_dimension and site_setback dictionaries
site_width = llm_dict.get('site_dimension', {}).get('width')
site_length = llm_dict.get('site_dimension', {}).get('length')

site_setback_front = llm_dict.get('site_setback', {}).get('front')
site_setback_side = llm_dict.get('site_setback', {}).get('side')
site_setback_rear = llm_dict.get('site_setback', {}).get('rear')


# Optional: print or store the extracted data
print("Building Type:", building_type)
print("Site Location:", site_location)
print("Site Dimensions: Width =", site_width, "Length =", site_length)
print("Setbacks: Front =", site_setback_front, "Side =", site_setback_side, "Rear =", site_setback_rear)
# ---------- end py3_5 ----------
panel_8 = Panel(py3_5.site_location)
panel_9 = Panel(py3_5.site_width)
panel_10 = Panel(py3_5.site_length)
panel_11 = Panel(py3_5.building_type)
justified_text = JustifiedText3d(
    Location=vector_xyz.Vector,
    Text=concatenate,
    Size=Slider(0.75, range=0..1),
    Color=ColourSwatch(SwatchColor=RGB(0, 0, 0)),
    HorizontalAlignment="0",
    VerticalAlginment=1,
    Font="Ariel",
    UseMeshes=False,
    Bake=False)

# ---- group: Street Axis
construct_point = ConstructPoint(XCoordinate=Slider(-20, range=-100..100), YCoordinate=Slider(37.5, range=0..100), ZCoordinate=0)
construct_point_2 = ConstructPoint(XCoordinate=Slider(45, range=0..100), YCoordinate=Slider(37.5, range=0..100), ZCoordinate=0)
line = Line(StartPoint=construct_point_2, EndPoint=construct_point)

# ----
panel_12 = Panel("https://climate.onebuilding.org/WMO_Region_6_Europe/PRT_Portugal/NO_Norte/PRT_NO_Porto-Carneiro.AP.085450_TMYx.2004-2018.zip")
downloadepw = LBDownloadWeather(weather_URL=panel_12)  # -> epw_file, stat_file, ddy_file; plug-in component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

# ----
# Extra floor plan representation
panel_13 = Panel("0,0,0")
vector_2pt = Vector2Pt(PointA=panel_13, PointB="-22,0,0", Unitize=False)  # -> Vector, Length

window_settings = WindowSettings(AnchorPoint="0", Position="0")  # -> WindowSettings, LibraryPart

# ----
# Floor Plan Graph
number_slider = Slider(0.6, range=0..10)
vector_2pt_2 = Vector2Pt(PointA="0,0,0", PointB="22,0,0", Unitize=False)  # -> Vector, Length
vector_2pt_3 = Vector2Pt(PointA="0,-1,0", PointB="22,0,0", Unitize=False)  # -> Vector, Length

# ---- group: Terrain Surface
rectangle = Rectangle(Plane=PlaneXY(0, 0, 0), XSize=panel_9, YSize=panel_10, Radius=0)  # -> Rectangle, Length
boundary_surfaces = BoundarySurfaces(Edges=rectangle.Rectangle)

# ----
evaluate_curve = EvaluateCurve(Curve=rectangle.Rectangle, Parameter=layout_options)  # -> Point, Tangent, Angle
houseinstanceadvanced = HouseInstanceAdvanced(
    Boundary=rectangle.Rectangle,
    EntrancePoint=evaluate_curve.Point,
    RoomAreas=area,
    RoomNames=rooms,
    IsHall=py3_4.a,
    Adjacency=panel_6,
    RotateBoundary=False)

# ---- group: Remember: remove corridors
magnetizingrooms_es = MagnetizingRooms_ES(HouseInstance=houseinstanceadvanced, Iterations="200", MaxAdjDistance=2, CellSizeM=1)  # -> Corridors, RoomBreps, RoomNames, Adjacencies, MissingAdjacences, Boundary, BoundaryOffset

# ----
panel_14 = Panel(magnetizingrooms_es.RoomNames)

# ---- group: Realocate the origin to the center of the rectangle
area_2 = Area(Geometry=magnetizingrooms_es.RoomBreps)  # -> Area, Centroid
average = Average(Input=area_2.Centroid)
vector_2pt_4 = Vector2Pt(PointA=average, PointB="12.5,15,0", Unitize=False)  # -> Vector, Length
move = Move(Geometry=magnetizingrooms_es.RoomBreps, Motion=vector_2pt_4.Vector)  # -> Geometry, Transform
move_2 = Move(Geometry=magnetizingrooms_es.Corridors, Motion=vector_2pt_4.Vector)  # -> Geometry, Transform

# ---- group: Name legend
py3_6 = Python3Script(room_names=magnetizingrooms_es.RoomNames)  # -> out, clean_names; inputs room_names: list
# ---------- py3_6: Python ----------
clean_names = []
for name in room_names:
    if "&&HALL&&" in name:
        clean_name = name.replace("&&HALL&&", "")  # Remove "&&HALL&&"
        clean_names.append(clean_name)
    else:
        clean_names.append(name)
# ---------- end py3_6 ----------
brep = Brep(move.Geometry)
area_3 = Area(Geometry=brep)  # -> Area, Centroid
justified_text_2 = JustifiedText3d(
    Location=area_3.Centroid,
    Text=py3_6.clean_names,
    Size=Slider(0.265, range=0..1),
    Color=ColourSwatch(SwatchColor=RGB(0, 0, 0)),
    HorizontalAlignment=1,
    VerticalAlginment=1,
    Font="Verdana",
    UseMeshes=False,
    Bake=False)

# ----
py3_7 = Python3Script(room_names=rooms, placed_room_names=py3_6.clean_names)  # -> out, error; inputs room_names: list, placed_room_names: list
# ---------- py3_7: Python ----------
error = False
for name in room_names:
    if name not in placed_room_names:
        error = True
        break
# ---------- end py3_7 ----------
panel_15 = Panel(py3_7.error)
py3_8 = Python3Script(room_names=rooms, placed_room_names=py3_6.clean_names, error=panel_15)  # -> out, a; inputs room_names: list, placed_room_names: list
# ---------- py3_8: Python ----------
import System.Drawing

# Categorias
social = ("living room", "kitchen", "foyer", "dining room", "toilet")
service = ("laundry", "deposit 1", "deposit 2")
private = ("art studio", "library", "studio", "corridor", "office", "bedroom", "bedroom 1","bedroom 2","bedroom 3","bathroom", "bathroom 1", "bathroom 2", "bathroom 3")

# Cores RGB como tuplas
colors = {
    "social": (160, 196, 151),
    "service": (227, 183, 129),
    "private": (222, 126, 147),
    "default": (0, 0, 0)
}

# Dicionário de cores associadas
room_colors = []
for room in room_names:
    if room in social:
        room_colors.append(colors["social"])
    elif room in service:
        room_colors.append(colors["service"])
    elif room in private:
        room_colors.append(colors["private"])
    else:
        room_colors.append(colors["default"])

# Dicionário room name -> cor RGB
name_to_color = dict(zip(room_names, room_colors))

# Construir lista final
ordered_colors = []
if error == "True":
    default_color = System.Drawing.Color.FromArgb(0,0,0)
    ordered_colors = [default_color for _ in placed_room_names]
else:
    for name in placed_room_names:
        rgb = name_to_color.get(name, colors["default"])
        color = System.Drawing.Color.FromArgb(rgb[0], rgb[1], rgb[2])
        ordered_colors.append(color)

# Output
a = ordered_colors
# ---------- end py3_8 ----------

# ---- group: Rooms coloring
mesh = Mesh(move.Geometry)
mesh_edges = MeshEdges(Mesh=mesh)  # -> NakedEdges, InteriorEdges, NonManifoldEdges
join_curves = JoinCurves(Curves=mesh_edges.NakedEdges, Preserve=False)  # -> simplify(Curves)
data = Data(flatten(join_curves))
boundary_surfaces_2 = BoundarySurfaces(Edges=data)  # -> flatten(Surfaces)
preview = CustomPreview(
    Geometry=boundary_surfaces_2,
    Material={diffuse=RGB(221, 160, 221), emission=RGB(66, 48, 66), shine=0.5, specular=RGB(255, 255, 255), transparency=0})

# ---- group: Room pairs by adjacency
list_length = ListLength(List=move.Geometry)
series = Series(Start=0, Step=1, Count=list_length)
py3_9 = Python3Script(room_names=rooms, room_indices=series, placed_room_names=py3_6.clean_names)  # -> out, reordered_indices; inputs room_names: list, room_indices: list, placed_room_names: list
# ---------- py3_9: Python ----------
placed_name_to_index = {name: i for i, name in enumerate(placed_room_names)}
reordered_indices = [placed_name_to_index[name] for name in room_names]
# ---------- end py3_9 ----------
text_split = TextSplit(Text=panel_6, Separators="-")
list_item = ListItem(List=move.Geometry, Index=py3_9.reordered_indices, Wrap=True)
subtraction = Subtraction(A=text_split, B="1")
list_item_2 = ListItem(List=list_item, Index=subtraction, Wrap=True)

# ----
area_4 = Area(Geometry=list_item_2)  # -> Area, Centroid
split_list = SplitList(List=simplify(area_4.Centroid), Index="1")  # -> simplify(ListA), simplify(ListB)
circle = Circle(Plane=area_3.Centroid, Radius=number_slider)  # -> simplify(Circle)
line_2 = Line(StartPoint=split_list.ListA, EndPoint=split_list.ListB)
move_3 = Move(Geometry=circle, Motion=vector_2pt_3.Vector)  # -> Geometry, Transform
move_4 = Move(Geometry=circle, Motion=vector_2pt_2.Vector)  # -> Geometry, Transform
move_5 = Move(Geometry=line_2, Motion=vector_2pt_2.Vector)  # -> Geometry, Transform
area_5 = Area(Geometry=move_3.Geometry)  # -> Area, Centroid
boundary_surfaces_3 = BoundarySurfaces(Edges=move_4.Geometry)
custom_preview = CustomPreview(Geometry=boundary_surfaces_3, Material=py3_8.a)
justified_text_3 = JustifiedText3d(
    Location=area_5.Centroid,
    Text=py3_6.clean_names,
    Size=Slider(0.33, range=0..1),
    Color=ColourSwatch(SwatchColor=RGB(0, 0, 0)),
    HorizontalAlignment=1,
    VerticalAlginment=1,
    Font="Arial",
    UseMeshes=False,
    Bake=False)
custom_preview_lineweights = CustomPreviewLineweights(
    Geometry=flatten(move_5.Geometry),
    Shader=ColourSwatch(SwatchColor=RGB(0, 0, 0)),
    Thickness=Slider(0.05, range=0..10),
    Absolute="True")

# ---- group: Getting the rooms boundaries
curve = Curve(flatten(join_curves))
discontinuity = Discontinuity(Curve=curve, Level=1)  # -> Points, Parameters
curve_closest_point = CurveClosestPoint(Point=flatten(discontinuity.Points), Curve=graft(curve))  # -> Point, Parameter, Distance
boolean = Boolean(curve_closest_point.Distance)
dispatch = Dispatch(List=curve_closest_point.Parameter, DispatchPattern=boolean)  # -> ListA, ListB
shatter = Shatter(Curve=graft(curve), Parameters=dispatch.ListB)

# ---- group: Corridors coloring
preview_2 = CustomPreview(Geometry=move_2.Geometry, Material=ColourSwatch(SwatchColor=RGB(255, 255, 255)))

# ---- group: Room coloring - zone
preview_3 = CustomPreview(Geometry=boundary_surfaces_2, Material=py3_8.a)

# ----
room_names = Panel(py3_6.clean_names)

# ----
# Windows quant. in order
member_index = MemberIndex(Set=rooms, Member=room_names)  # -> simplify(flatten(Index)), Count
list_item_3 = ListItem(List=windows_count, Index=member_index.Index, Wrap=True)  # -> flatten(Item)
windows_count_correct_order = Panel(list_item_3)
smaller_than = SmallerThan(FirstNumber=list_item_3, SecondNumber="0")  # -> SmallerThan, OrEqualTo
cull_pattern = CullPattern(List=room_names, CullPattern=smaller_than.OrEqualTo)
panel_16 = Panel(cull_pattern)

panel_17 = Panel(py3_6.clean_names)

# ---- group: Max and Min in X and Y
# Exploding the surface
# to get the limits
bounding_box = BoundingBox(Content=rectangle.Rectangle, Plane=PlaneXY(0, 0, 0))  # -> Box, Box_2
deconstruct_box = DeconstructBox(Box=bounding_box.Box)  # -> Plane, X, Y, Z
unit_x = UnitX(Factor=deconstruct_box.X)
unit_y = UnitY(Factor=deconstruct_box.Y)
deconstruct = Deconstruct(Point=unit_x)  # -> XComponent, YComponent, ZComponent
deconstruct_2 = Deconstruct(Point=unit_y)  # -> XComponent, YComponent, ZComponent
maximum = Maximum(A=deconstruct.XComponent, B=deconstruct.YComponent)  # -> flatten(Result)
minimum = Minimum(A=deconstruct.XComponent, B=deconstruct.YComponent)  # -> flatten(Result)
maximum_2 = Maximum(A=deconstruct_2.XComponent, B=deconstruct_2.YComponent)  # -> flatten(Result)
minimum_2 = Minimum(A=deconstruct_2.XComponent, B=deconstruct_2.YComponent)  # -> flatten(Result)
panel_18 = Panel(maximum)
panel_19 = Panel(minimum)
panel_20 = Panel(maximum_2)
panel_21 = Panel(minimum_2)

# ----
panel_22 = Panel(py3_9.reordered_indices)
panel_23 = Panel(text_split)

# ----
# Doors
panel_24 = Panel("1")
split_list_2 = SplitList(List=list_item_2, Index=panel_24)  # -> ListA, ListB
curve_curve = CurveCurve(CurveA=split_list_2.ListA, CurveB=split_list_2.ListB)  # -> Points, ParamsA, ParamsB
average_2 = Average(Input=curve_curve.Points)  # -> simplify(ArithmeticMean)
door_wdith = Slider(0.8, range=0..1.2)
circle_2 = Circle(Plane=average_2, Radius=expr("x/2", door_wdith))  # -> simplify(Circle)
list_item_4 = ListItem(List=list_item_2, Index=0, Wrap=True)
curve_curve_2 = CurveCurve(CurveA=list_item_4, CurveB=circle_2)  # -> Points, ParamsA, ParamsB
split_list_3 = SplitList(List=curve_curve_2.Points, Index="1")  # -> ListA, ListB
line_3 = Line(StartPoint=split_list_3.ListA, EndPoint=split_list_3.ListB)
end_points = EndPoints(Curve=graft(line_3))  # -> Start, End
length = Length(Curve=graft(line_3))
perp_frame = PerpFrame(Curve=graft(line_3), Parameter="0")
data_2 = Data(reverse(end_points.End))
deconstruct_plane = DeconstructPlane(Plane=perp_frame)  # -> Origin, XAxis, YAxis, ZAxis
reverse = Reverse(Vector=deconstruct_plane.YAxis)
line_sdl = LineSDL(Start=deconstruct_plane.Origin, Direction=reverse, Length=length)
circle_3 = Circle(Plane=deconstruct_plane.Origin, Radius=length)
end_points_2 = EndPoints(Curve=line_sdl)  # -> Start, End
data_3 = Data(end_points_2.End)
merge = Merge(Data1=data_3, Data2=data_2)
curve_closest_point_2 = CurveClosestPoint(Point=merge, Curve=circle_3)  # -> Point, Parameter, Distance
shatter_2 = Shatter(Curve=circle_3, Parameters=curve_closest_point_2.Parameter)
length_2 = Length(Curve=shatter_2)
sort_list = SortList(Keys=length_2, ValuesValuesA=shatter_2)  # -> Keys, ValuesValuesA
list_item_5 = ListItem(List=sort_list.ValuesValuesA, Index=0, Wrap=True)
merge_2 = Merge(Data1=line_sdl, Data2=list_item_5, Data3=line_3)
data_4 = Data(merge_2)

# ----
# Interior Walls
curve_middle = CurveMiddle(Curve=shatter)
cull_duplicates = CullDuplicates(Points=curve_middle, Tolerance=0.1, CullMode=3)  # -> Points, Indices, Valence
pull_point = PullPoint(Point=cull_duplicates.Points, Geometry=flatten(average_2), ClosestOnly=True)  # -> ClosestPoint, Distance, Index
smaller_than_2 = SmallerThan(FirstNumber=pull_point.Distance, SecondNumber="0.01")  # -> simplify(SmallerThan), OrEqualTo
dispatch_2 = Dispatch(List=cull_duplicates.Points, DispatchPattern=smaller_than_2.SmallerThan)  # -> ListA, ListB
data_5 = Data(simplify(dispatch_2.ListA))
dispatch_3 = Dispatch(List=shatter, DispatchPattern=smaller_than_2.SmallerThan)  # -> ListA, ListB
data_6 = Data(simplify(dispatch_3.ListA))
circle_4 = Circle(Plane=data_5, Radius=expr("x/2", door_wdith))
curve_curve_3 = CurveCurve(CurveA=data_6, CurveB=circle_4)  # -> Points, ParamsA, ParamsB
trim_tree = TrimTree(Tree=curve_curve_3.ParamsA, Depth=1)
cull_duplicates_2 = CullDuplicates(Points=flatten(data_5), Tolerance=0.1, CullMode=3)  # -> Points, Indices, Valence
shatter_3 = Shatter(Curve=data_6, Parameters=trim_tree)
trim_tree_2 = TrimTree(Tree=shatter_3, Depth=1)
flatten_tree = FlattenTree(Tree=trim_tree_2, Path="{0}")
pull_point_2 = PullPoint(Point=cull_duplicates_2.Points, Geometry=graft(flatten_tree), ClosestOnly=True)  # -> ClosestPoint, Distance, Index
mass_multiplication = MassMultiplication(Input=pull_point_2.Distance)  # -> Result, PartialResults
smaller_than_3 = SmallerThan(FirstNumber=mass_multiplication.Result, SecondNumber="0.01")  # -> SmallerThan, OrEqualTo
dispatch_4 = Dispatch(List=flatten_tree, DispatchPattern=flatten(smaller_than_3.SmallerThan))  # -> ListA, ListB

# ---- group: Min and max area in order
python_3_script_2 = Python3Script(layout_amb=room_names)  # -> out, areas_max, areas_min; inputs layout_amb: list
# ---------- python_3_script_2: Python ----------
# Listas originais fixas (você pode ajustar aqui, se quiser)
nomes_ambientes = [
    "foyer", "livingroom", "diningroom", "kitchen",
    "laundry", "toilet", "corridor", "office",
    "bedroom1", "bathroom1", "bedroom2", "bathroom2"
]

areas_min = [2, 10, 8, 6, 3, 2, 5, 6, 9, 4, 7, 4]
areas_max = [4, 22, 15, 10, 6, 3, 10, 10, 12, 6, 9, 6]

# Aqui começa o código que usa a entrada layout_ambientes
areas_min_associadas = []
areas_max_associadas = []

for amb in layout_amb:
    if amb in nomes_ambientes:
        idx = nomes_ambientes.index(amb)
        areas_min_associadas.append(areas_min[idx])
        areas_max_associadas.append(areas_max[idx])
    else:
        # Se o nome do ambiente não estiver na lista original,
        # adiciona None ou um valor padrão (exemplo: 0)
        areas_min_associadas.append(None)
        areas_max_associadas.append(None)

# Saídas para o Grasshopper
areas_min = areas_min_associadas
areas_max = areas_max_associadas
# ---------- end python_3_script_2 ----------

# ---- group: Doors
move_6 = Move(Geometry=data_4, Motion=vector_2pt.Vector)  # -> Geometry, Transform
custom_preview_lineweights_2 = CustomPreviewLineweights(
    Geometry=flatten(move_6.Geometry),
    Shader=ColourSwatch(SwatchColor=RGB(0, 0, 0)),
    Thickness=Slider(0.05, range=0..10),
    Absolute="True")

# ---- group: Room name
move_7 = Move(Geometry=brep, Motion=vector_2pt.Vector)  # -> Geometry, Transform
area_6 = Area(Geometry=move_7.Geometry)  # -> Area, Centroid
justified_text_4 = JustifiedText3d(
    Location=area_6.Centroid,
    Text=py3_6.clean_names,
    Size=Slider(0.265, range=0..1),
    Color=ColourSwatch(SwatchColor=RGB(0, 0, 0)),
    HorizontalAlignment=1,
    VerticalAlginment=1,
    Font="Verdana",
    UseMeshes=False,
    Bake=False)

# ---- group: Walls without doors
data_7 = Data(dispatch_4.ListB)

# ---- group: Doors
data_8 = Data(line_3)

# ----
# Applying setbacks in terrain
explode = Explode(Curve=rectangle.Rectangle, Recursive=True)  # -> Segments, Vertices
front_setback = Panel("3")
side_setback = Panel("5")
rear_setback = Panel("5")
negative = Negative(Value=front_setback)
negative_2 = Negative(Value=side_setback)
negative_3 = Negative(Value=rear_setback)

# ---- group: Front limit
list_item_6 = ListItem(List=explode.Segments, Index="2", Wrap=True)
data_9 = Data(list_item_6)

# ---- group: Side limit
list_item_7 = ListItem(List=explode.Segments, Index="1", Wrap=True)
list_item_8 = ListItem(List=explode.Segments, Index="3", Wrap=True)
data_10 = Data(list_item_7)
data_11 = Data(list_item_8)

# ---- group: Rear limit
list_item_9 = ListItem(List=explode.Segments, Index="0", Wrap=True)
data_12 = Data(list_item_9)

# ----
offset_curve = OffsetCurve(Curve=data_11, Distance=negative_2, Corners=1)
offset_curve_2 = OffsetCurve(Curve=data_10, Distance=negative_2, Corners=1)
offset_curve_3 = OffsetCurve(Curve=data_9, Distance=negative, Corners=1)
offset_curve_4 = OffsetCurve(Curve=data_12, Distance=negative_3, Corners=1)
curve_curve_4 = CurveCurve(CurveA=offset_curve_3, CurveB=offset_curve_2)  # -> Points, ParamsA, ParamsB
curve_curve_5 = CurveCurve(CurveA=offset_curve_3, CurveB=offset_curve)  # -> Points, ParamsA, ParamsB
curve_curve_6 = CurveCurve(CurveA=offset_curve, CurveB=offset_curve_4)  # -> Points, ParamsA, ParamsB
curve_curve_7 = CurveCurve(CurveA=offset_curve_2, CurveB=offset_curve_4)  # -> Points, ParamsA, ParamsB
merge_3 = Merge(Data1=curve_curve_5.Points, Data2=curve_curve_4.Points, Data3=curve_curve_7.Points, Data4=curve_curve_6.Points)
polyline = PolyLine(Vertices=merge_3, Closed=Toggle(True))
boundary_surfaces_4 = BoundarySurfaces(Edges=polyline)
dimensions = Dimensions(Surface=boundary_surfaces_4)  # -> flatten(UDimension), flatten(VDimension)
panel_25 = Panel(dimensions.UDimension)
panel_26 = Panel(dimensions.VDimension)
divide_surface = DivideSurface(Surface=boundary_surfaces_4, UCount=panel_25, VCount=panel_26)  # -> Points, Normals, Parameters

# ---- group: Terrain Surface (continued)
evaluate_surface = EvaluateSurface(Surface=boundary_surfaces, Point=divide_surface.Points)  # -> flatten(Point), Normal, UDirection, VDirection, Frame

# ----
rectangle_2 = Rectangle(Plane=curve_curve_6.Points, XSize=dimensions.UDimension, YSize=dimensions.VDimension, Radius=0)  # -> Rectangle, Length
# Distance of each point
# to the axis of the street
curve_closest_point_3 = CurveClosestPoint(Point=evaluate_surface.Point, Curve=line)  # -> Point, Parameter, Distance
point_list = PointList(Points=evaluate_surface.Point, Size=0.3)

# ---- group: Noise level classification
# Very noise
# Noise
# Little noise
panel_27 = Panel("22")
smaller_than_4 = SmallerThan(FirstNumber=curve_closest_point_3.Distance, SecondNumber="15")  # -> SmallerThan, OrEqualTo
larger_than = LargerThan(FirstNumber=curve_closest_point_3.Distance, SecondNumber="15")  # -> LargerThan, OrEqualTo
smaller_than_5 = SmallerThan(FirstNumber=curve_closest_point_3.Distance, SecondNumber="22")  # -> SmallerThan, OrEqualTo
larger_than_2 = LargerThan(FirstNumber=curve_closest_point_3.Distance, SecondNumber=panel_27)  # -> LargerThan, OrEqualTo
gate_and = GateAnd(A=larger_than.LargerThan, B=smaller_than_5.SmallerThan)
replace_text_3 = ReplaceText(Text=smaller_than_4.SmallerThan, Find="True", Replace="high", RecursiveReplace=False)
replace_text_4 = ReplaceText(Text=gate_and, Find="True", Replace="medium", RecursiveReplace=False)
replace_text_5 = ReplaceText(Text=larger_than_2.LargerThan, Find="True", Replace="low", RecursiveReplace=False)
panel_28 = Panel(replace_text_5)
panel_29 = Panel(replace_text_4)
panel_30 = Panel(replace_text_3)
replace_text_6 = ReplaceText(Text=replace_text_5, Find="False", RecursiveReplace=False)  # -> flatten(Result)
replace_text_7 = ReplaceText(Text=replace_text_4, Find="False", Replace=replace_text_6, RecursiveReplace=False)  # -> flatten(Result)
replace_text_8 = ReplaceText(Text=replace_text_3, Find="False", Replace=replace_text_7, RecursiveReplace=False)  # -> flatten(Result)
panel_31 = Panel(replace_text_8)

# ----
join_curves_2 = JoinCurves(Curves=data, Preserve=False)  # -> graft(Curves)
point_in_curve = PointInCurve(Point=flatten(evaluate_surface.Point), Curve=simplify(graft(join_curves_2)))  # -> Relationship, Point
list_length_2 = ListLength(List=point_in_curve.Point)
equality = Equality(FirstNumber=point_in_curve.Relationship, SecondNumber="2")  # -> Equality, Inequality
series_2 = Series(Start=0, Step=1, Count=list_length_2)  # -> simplify(Series)
# Getting the points in each room
dispatch_5 = Dispatch(List=series_2, DispatchPattern=equality.Equality)  # -> ListA, ListB
explode_tree = ExplodeTree(Data=dispatch_5.ListA)  # -> Branch0, Branch1, Branch2, Branch3, Branch4, Branch5, Branch6, Branch7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
data_13 = Data(explode_tree.Branch1)
data_14 = Data(explode_tree.Branch2)
data_15 = Data(explode_tree.Branch0)
data_16 = Data(explode_tree.Branch3)
data_17 = Data(explode_tree.Branch4)
data_18 = Data(explode_tree.Branch5)
data_19 = Data(explode_tree.Branch6)
data_20 = Data(explode_tree.Branch7)
data_21 = Data(explode_tree.Branch8)
data_22 = Data(explode_tree.Branch9)
data_23 = Data(explode_tree.Branch10)

# ---- group: Getting X and Y separately
deconstruct_3 = Deconstruct(Point=evaluate_surface.Point)  # -> XComponent, YComponent, ZComponent

# ---- group: Calculating the distante of each point to terrain limits
# North dist.
# South dist.
# East dist.
# West dist.
subtraction_2 = Subtraction(A=panel_20, B=deconstruct_3.YComponent)
subtraction_3 = Subtraction(A=deconstruct_3.YComponent, B=panel_21)
subtraction_4 = Subtraction(A=panel_18, B=deconstruct_3.XComponent)
subtraction_5 = Subtraction(A=deconstruct_3.XComponent, B=panel_19)
panel_32 = Panel(subtraction_2)
panel_33 = Panel(subtraction_3)
panel_34 = Panel(subtraction_4)
panel_35 = Panel(subtraction_5)

# ----
panel_36 = Panel(evaluate_surface.Point)
data_24 = Data(explode_tree.Branch11)

# ---- group: Solar analysis
# JUNE
# DEZEMBER
# Surrounding area
# MARCH
# SEPTEMBER
importloc = LBImportLocation(epw_file=downloadepw.epw_file)  # -> location; plug-in component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
importepw = LBImportEPW(epw_file=downloadepw.epw_file)  # -> location, dry_bulb_temperature, dew_point_temperature, relative_humidity, wind_speed, wind_direction, direct_normal_rad, diffuse_horizontal_rad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; plug-in component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
geometry = Geometry([<brep referenced from the Rhino model> x48, <extrusion referenced from the Rhino model>, <brep referenced from the Rhino model> x3])
panel_37 = Panel(importloc)
custom_preview_2 = CustomPreview(Geometry=geometry, Material=ColourSwatch(SwatchColor=RGB(255, 255, 255)))
analysisperiod = LBAnalysisPeriod(start_month="3", start_day="21", start_hour=0, end_month="3", end_day="21")  # -> period, hoys, dates; plug-in component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
analysisperiod_2 = LBAnalysisPeriod(start_month="9", start_day="21", start_hour=0, end_month="9", end_day="21")  # -> period, hoys, dates; plug-in component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
analysisperiod_3 = LBAnalysisPeriod(start_month="6", start_day="21", start_hour=0, end_month="6", end_day="21")  # -> period, hoys, dates; plug-in component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
analysisperiod_4 = LBAnalysisPeriod(start_month="12", start_day="21", start_hour=0, end_month="12", end_day="21")  # -> period, hoys, dates; plug-in component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
construct_point_3 = ConstructPoint(XCoordinate=Slider(13, range=0..150), YCoordinate=Slider(15, range=0..100), ZCoordinate=0)
construct_point_4 = ConstructPoint(XCoordinate=Slider(13, range=0..150), YCoordinate=Slider(15, range=0..100), ZCoordinate=0)
construct_point_5 = ConstructPoint(XCoordinate=Slider(13, range=0..150), YCoordinate=Slider(15, range=0..100), ZCoordinate=0)
construct_point_6 = ConstructPoint(XCoordinate=Slider(13, range=0..150), YCoordinate=Slider(15, range=0..100), ZCoordinate=0)
sunpath = LBSunPath(
    north=Slider(350, range=0..360),
    location=importepw.location,
    hoys=analysisperiod.hoys,
    center_pt=construct_point_4,
    scale=1,
    data=importepw.dry_bulb_temperature)  # -> out, vectors, altitudes, azimuths, hoys, sun_pts, analemma, daily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; plug-in component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
sunpath_2 = LBSunPath(
    north=Slider(350, range=0..360),
    location=importepw.location,
    hoys=analysisperiod_2.hoys,
    center_pt=construct_point_3,
    scale=1,
    data=importepw.dry_bulb_temperature)  # -> out, vectors, altitudes, azimuths, hoys, sun_pts, analemma, daily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; plug-in component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
sunpath_3 = LBSunPath(
    north=Slider(350, range=0..360),
    location=importepw.location,
    hoys=analysisperiod_3.hoys,
    center_pt=construct_point_5,
    scale=1,
    data=importepw.dry_bulb_temperature)  # -> out, vectors, altitudes, azimuths, hoys, sun_pts, analemma, daily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; plug-in component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
sunpath_4 = LBSunPath(
    north=Slider(350, range=0..360),
    location=importepw.location,
    hoys=analysisperiod_4.hoys,
    center_pt=construct_point_6,
    scale=1,
    data=importepw.dry_bulb_temperature)  # -> out, vectors, altitudes, azimuths, hoys, sun_pts, analemma, daily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; plug-in component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
directsunhours = LBDirectSunHours(
    vectors=flatten(sunpath_3.vectors),
    geometry=flatten(evaluate_surface.Frame),
    context=flatten(geometry),
    grid_size=Slider(1.5, range=0..100),
    offset_dist=Slider(1, range=0..100),
    run=Toggle(True))  # -> points, flatten(results), mesh, legend, title, int_mtx; plug-in component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
directsunhours_2 = LBDirectSunHours(
    vectors=flatten(sunpath_4.vectors),
    geometry=flatten(evaluate_surface.Frame),
    context=flatten(geometry),
    grid_size=Slider(1.5, range=0..100),
    offset_dist=Slider(1, range=0..100),
    run=Toggle(True))  # -> out, points, flatten(results), mesh, legend, title, int_mtx; plug-in component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
directsunhours_3 = LBDirectSunHours(
    vectors=flatten(sunpath.vectors),
    geometry=flatten(evaluate_surface.Frame),
    context=flatten(geometry),
    grid_size=Slider(1.5, range=0..100),
    offset_dist=Slider(1, range=0..100),
    run=Toggle(True))  # -> out, points, results, mesh, legend, title, int_mtx; plug-in component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
directsunhours_4 = LBDirectSunHours(
    vectors=flatten(sunpath_2.vectors),
    geometry=flatten(evaluate_surface.Frame),
    context=flatten(geometry),
    grid_size=Slider(1.5, range=0..100),
    offset_dist=Slider(1, range=0..100),
    run=Toggle(True))  # -> out, points, results, mesh, legend, title, int_mtx; plug-in component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
panel_38 = Panel(directsunhours.results)
panel_39 = Panel(directsunhours_3.results)
panel_40 = Panel(directsunhours_4.results)
panel_41 = Panel(directsunhours_2.results)

# ----
# Output Noise Level
list_item_10 = ListItem(List=panel_31, Index=data_15, Wrap=True)
list_item_11 = ListItem(List=panel_31, Index=data_13, Wrap=True)
list_item_12 = ListItem(List=panel_31, Index=data_14, Wrap=True)
list_item_13 = ListItem(List=panel_31, Index=data_16, Wrap=True)
list_item_14 = ListItem(List=panel_31, Index=data_17, Wrap=True)
list_item_15 = ListItem(List=panel_31, Index=data_18, Wrap=True)
list_item_16 = ListItem(List=panel_31, Index=data_19, Wrap=True)
list_item_17 = ListItem(List=panel_31, Index=data_20, Wrap=True)
list_item_18 = ListItem(List=panel_31, Index=data_21, Wrap=True)
list_item_19 = ListItem(List=panel_31, Index=data_22, Wrap=True)
list_item_20 = ListItem(List=panel_31, Index=data_23, Wrap=True)
list_item_21 = ListItem(List=panel_31, Index=data_24, Wrap=True)
panel_42 = Panel(list_item_16)
panel_43 = Panel(list_item_10)
panel_44 = Panel(list_item_11)
panel_45 = Panel(list_item_12)
panel_46 = Panel(list_item_13)
panel_47 = Panel(list_item_14)
panel_48 = Panel(list_item_17)
panel_49 = Panel(list_item_18)
panel_50 = Panel(list_item_19)
panel_51 = Panel(list_item_20)
panel_52 = Panel(list_item_15)
panel_53 = Panel(list_item_21)
replace_text_9 = ReplaceText(
    Text=[panel_52, panel_47, panel_46, panel_45, panel_44, panel_43, panel_42, panel_48, panel_49, panel_50, panel_51, panel_53],
    Find="low",
    Replace="0",
    RecursiveReplace=False)
replace_text_10 = ReplaceText(Text=replace_text_9, Find="medium", Replace="1", RecursiveReplace=False)
replace_text_11 = ReplaceText(Text=replace_text_10, Find="high", Replace="2", RecursiveReplace=False)
equality_2 = Equality(FirstNumber=replace_text_11, SecondNumber="1")  # -> Equality, Inequality
equality_3 = Equality(FirstNumber=replace_text_11, SecondNumber="0")  # -> Equality, Inequality
equality_4 = Equality(FirstNumber=replace_text_11, SecondNumber="2")  # -> Equality, Inequality
panel_54 = Panel(replace_text_11)
dispatch_6 = Dispatch(List=panel_54, DispatchPattern=equality_3.Equality)  # -> ListA, ListB
dispatch_7 = Dispatch(List=panel_54, DispatchPattern=equality_2.Equality)  # -> ListA, ListB
dispatch_8 = Dispatch(List=panel_54, DispatchPattern=equality_4.Equality)  # -> ListA, ListB
panel_55 = Panel(dispatch_6.ListA)
panel_56 = Panel(dispatch_8.ListA)
panel_57 = Panel(dispatch_7.ListA)
list_length_3 = ListLength(List=panel_55)
list_length_4 = ListLength(List=panel_57)
list_length_5 = ListLength(List=panel_56)
maximum_3 = Maximum(A=list_length_3, B=list_length_4)
merge_4 = Merge(Data1=list_length_3, Data2=list_length_4, Data3=list_length_5)
maximum_4 = Maximum(A=maximum_3, B=list_length_5)
member_index_2 = MemberIndex(Set=merge_4, Member=maximum_4)  # -> Index, Count
panel_58 = Panel(member_index_2.Index)
panel_59 = Panel("""low
medium
high""")
list_item_22 = ListItem(List=panel_59, Index=member_index_2.Index, Wrap=True)  # -> flatten(Item)
panel_60 = Panel(list_item_22)

# ----
# Output Sun Hours
# Summer
# Winter
list_item_23 = ListItem(List=panel_38, Index=data_15, Wrap=True)
list_item_24 = ListItem(List=panel_38, Index=data_13, Wrap=True)
list_item_25 = ListItem(List=panel_38, Index=data_14, Wrap=True)
list_item_26 = ListItem(List=panel_38, Index=data_16, Wrap=True)
list_item_27 = ListItem(List=panel_38, Index=data_17, Wrap=True)
list_item_28 = ListItem(List=panel_38, Index=data_18, Wrap=True)
list_item_29 = ListItem(List=panel_38, Index=data_19, Wrap=True)
list_item_30 = ListItem(List=panel_38, Index=data_20, Wrap=True)
list_item_31 = ListItem(List=panel_38, Index=data_21, Wrap=True)
list_item_32 = ListItem(List=panel_38, Index=data_22, Wrap=True)
list_item_33 = ListItem(List=panel_38, Index=data_23, Wrap=True)
list_item_34 = ListItem(List=panel_38, Index=data_24, Wrap=True)
panel_61 = Panel(list_item_32)
panel_62 = Panel(list_item_23)
panel_63 = Panel(list_item_24)
panel_64 = Panel(list_item_25)
panel_65 = Panel(list_item_26)
panel_66 = Panel(list_item_27)
panel_67 = Panel(list_item_28)
panel_68 = Panel(list_item_29)
panel_69 = Panel(list_item_30)
panel_70 = Panel(list_item_31)
panel_71 = Panel(list_item_33)
panel_72 = Panel(list_item_34)
mass_addition_2 = MassAddition(Input=panel_72)  # -> Result, PartialResults
mass_addition_3 = MassAddition(Input=panel_69)  # -> Result, PartialResults
mass_addition_4 = MassAddition(Input=panel_61)  # -> Result, PartialResults
mass_addition_5 = MassAddition(Input=panel_71)  # -> Result, PartialResults
mass_addition_6 = MassAddition(Input=panel_64)  # -> Result, PartialResults
mass_addition_7 = MassAddition(Input=panel_65)  # -> Result, PartialResults
mass_addition_8 = MassAddition(Input=panel_66)  # -> Result, PartialResults
mass_addition_9 = MassAddition(Input=panel_67)  # -> Result, PartialResults
mass_addition_10 = MassAddition(Input=panel_68)  # -> Result, PartialResults
mass_addition_11 = MassAddition(Input=panel_70)  # -> Result, PartialResults
mass_addition_12 = MassAddition(Input=panel_62)  # -> Result, PartialResults
mass_addition_13 = MassAddition(Input=panel_63)  # -> Result, PartialResults
list_length_6 = ListLength(List=panel_72)
list_length_7 = ListLength(List=panel_69)
list_length_8 = ListLength(List=panel_61)
list_length_9 = ListLength(List=panel_71)
list_length_10 = ListLength(List=panel_64)
list_length_11 = ListLength(List=panel_65)
list_length_12 = ListLength(List=panel_66)
list_length_13 = ListLength(List=panel_67)
list_length_14 = ListLength(List=panel_68)
list_length_15 = ListLength(List=panel_70)
list_length_16 = ListLength(List=panel_62)
list_length_17 = ListLength(List=panel_63)
division = Division(A=mass_addition_2.Result, B=list_length_6)
division_2 = Division(A=mass_addition_3.Result, B=list_length_7)
division_3 = Division(A=mass_addition_4.Result, B=list_length_8)
division_4 = Division(A=mass_addition_5.Result, B=list_length_9)
division_5 = Division(A=mass_addition_6.Result, B=list_length_10)
division_6 = Division(A=mass_addition_7.Result, B=list_length_11)
division_7 = Division(A=mass_addition_8.Result, B=list_length_12)
division_8 = Division(A=mass_addition_9.Result, B=list_length_13)
division_9 = Division(A=mass_addition_10.Result, B=list_length_14)
division_10 = Division(A=mass_addition_11.Result, B=list_length_15)
division_11 = Division(A=mass_addition_12.Result, B=list_length_16)
division_12 = Division(A=mass_addition_13.Result, B=list_length_17)
round_2 = Round(Number=[division_11, division_12, division_5, division_6, division_7, division_8, division_9, division_2, division_10, division_3, division_4, division])  # -> flatten(Nearest), Floor, Ceiling
list_item_35 = ListItem(List=panel_41, Index=data_15, Wrap=True)
list_item_36 = ListItem(List=panel_41, Index=data_13, Wrap=True)
list_item_37 = ListItem(List=panel_41, Index=data_14, Wrap=True)
list_item_38 = ListItem(List=panel_41, Index=data_16, Wrap=True)
list_item_39 = ListItem(List=panel_41, Index=data_17, Wrap=True)
list_item_40 = ListItem(List=panel_41, Index=data_18, Wrap=True)
list_item_41 = ListItem(List=panel_41, Index=data_19, Wrap=True)
list_item_42 = ListItem(List=panel_41, Index=data_20, Wrap=True)
list_item_43 = ListItem(List=panel_41, Index=data_21, Wrap=True)
list_item_44 = ListItem(List=panel_41, Index=data_22, Wrap=True)
list_item_45 = ListItem(List=panel_41, Index=data_23, Wrap=True)
list_item_46 = ListItem(List=panel_41, Index=data_24, Wrap=True)
panel_73 = Panel(list_item_35)
panel_74 = Panel(list_item_36)
panel_75 = Panel(list_item_37)
panel_76 = Panel(list_item_38)
panel_77 = Panel(list_item_39)
panel_78 = Panel(list_item_40)
panel_79 = Panel(list_item_41)
panel_80 = Panel(list_item_42)
panel_81 = Panel(list_item_43)
panel_82 = Panel(list_item_44)
panel_83 = Panel(list_item_45)
panel_84 = Panel(list_item_46)
output_sun_hours_summer = Panel(round_2.Nearest)
mass_addition_14 = MassAddition(Input=panel_80)  # -> Result, PartialResults
mass_addition_15 = MassAddition(Input=panel_82)  # -> Result, PartialResults
mass_addition_16 = MassAddition(Input=panel_83)  # -> Result, PartialResults
mass_addition_17 = MassAddition(Input=panel_84)  # -> Result, PartialResults
mass_addition_18 = MassAddition(Input=panel_75)  # -> Result, PartialResults
mass_addition_19 = MassAddition(Input=panel_76)  # -> Result, PartialResults
mass_addition_20 = MassAddition(Input=panel_77)  # -> Result, PartialResults
mass_addition_21 = MassAddition(Input=panel_78)  # -> Result, PartialResults
mass_addition_22 = MassAddition(Input=panel_79)  # -> Result, PartialResults
mass_addition_23 = MassAddition(Input=panel_81)  # -> Result, PartialResults
mass_addition_24 = MassAddition(Input=panel_73)  # -> Result, PartialResults
mass_addition_25 = MassAddition(Input=panel_74)  # -> Result, PartialResults
list_length_18 = ListLength(List=panel_80)
list_length_19 = ListLength(List=panel_82)
list_length_20 = ListLength(List=panel_83)
list_length_21 = ListLength(List=panel_84)
list_length_22 = ListLength(List=panel_75)
list_length_23 = ListLength(List=panel_76)
list_length_24 = ListLength(List=panel_77)
list_length_25 = ListLength(List=panel_78)
list_length_26 = ListLength(List=panel_79)
list_length_27 = ListLength(List=panel_81)
list_length_28 = ListLength(List=panel_73)
list_length_29 = ListLength(List=panel_74)
division_13 = Division(A=mass_addition_14.Result, B=list_length_18)
division_14 = Division(A=mass_addition_15.Result, B=list_length_19)
division_15 = Division(A=mass_addition_16.Result, B=list_length_20)
division_16 = Division(A=mass_addition_17.Result, B=list_length_21)
division_17 = Division(A=mass_addition_18.Result, B=list_length_22)
division_18 = Division(A=mass_addition_19.Result, B=list_length_23)
division_19 = Division(A=mass_addition_20.Result, B=list_length_24)
division_20 = Division(A=mass_addition_21.Result, B=list_length_25)
division_21 = Division(A=mass_addition_22.Result, B=list_length_26)
division_22 = Division(A=mass_addition_23.Result, B=list_length_27)
division_23 = Division(A=mass_addition_24.Result, B=list_length_28)
division_24 = Division(A=mass_addition_25.Result, B=list_length_29)
round_3 = Round(Number=[division_23, division_24, division_17, division_18, division_19, division_20, division_21, division_13, division_22, division_14, division_15, division_16])  # -> flatten(Nearest), Floor, Ceiling
output_sun_hours_winter = Panel(round_3.Nearest)

# ---- group: Joining info with parameter name
concatenate_2 = Concatenate(FragmentA="Coordenates: ", FragmentB=panel_36)
concatenate_3 = Concatenate(Fragment_A="North dist.: ", Fragment_B=panel_32, A="m")
concatenate_4 = Concatenate(Fragment_A="South dist.: ", Fragment_B=panel_33, A="m")
concatenate_5 = Concatenate(Fragment_A="East dist.: ", Fragment_B=panel_34, A="m")
concatenate_6 = Concatenate(Fragment_A="West dist.: ", Fragment_B=panel_35, A="m")
concatenate_7 = Concatenate(Fragment_A="Street axis dist.: ", Fragment_B=curve_closest_point_3.Distance, A="m")
concatenate_8 = Concatenate(FragmentA="Noise level: ", FragmentB=replace_text_8)
concatenate_9 = Concatenate(Fragment_A="Direct sun hours Summer(June 21st): ", Fragment_B=directsunhours.results, A="h")
concatenate_10 = Concatenate(Fragment_A="Direct sun hours Winter (Dezember 21st): ", Fragment_B=directsunhours_2.results, A="h")
entwine = Entwine(
    Branch00=concatenate_2,
    Branch01=concatenate_3,
    Branch02=concatenate_4,
    Branch03=concatenate_5,
    Branch04=concatenate_6,
    Branch05=concatenate_7,
    Branch06=concatenate_8,
    Branch07=concatenate_9,
    Branch08=concatenate_10,
    FlattenInputs=True)  # -> simplify(Result)

# ----
panel_85 = Panel(entwine)
flip_matrix = FlipMatrix(Data=panel_85)
panel_86 = Panel(flip_matrix)

# ----
# Site General Information
number_slider_2 = Slider(0, range=-1..1)
vector_xyz_2 = VectorXYZ(XComponent=number_slider_2, YComponent=Slider(-1, range=-10..1), ZComponent=0)  # -> Vector, Length
vector_xyz_3 = VectorXYZ(XComponent=Slider(0, range=-1..1), YComponent=Slider(-1.8, range=-10..1), ZComponent=0)  # -> Vector, Length
concatenate_11 = Concatenate(FragmentA="Type: ", FragmentB=panel_11)
vector_xyz_4 = VectorXYZ(XComponent=Slider(0, range=-1..1), YComponent=Slider(-2.4, range=-10..1), ZComponent=0)  # -> Vector, Length
concatenate_12 = Concatenate(FragmentA="Location: ", FragmentB=panel_8)
justified_text_5 = JustifiedText3d(
    Location=vector_xyz_4.Vector,
    Text=concatenate_12,
    Size=Slider(0.351, range=0..1),
    Color=ColourSwatch(SwatchColor=RGB(0, 0, 0)),
    HorizontalAlignment="0",
    VerticalAlginment=1,
    Font="Verdana",
    UseMeshes=False,
    Bake=False)
justified_text_6 = JustifiedText3d(
    Location=vector_xyz_3.Vector,
    Text=concatenate_11,
    Size=Slider(0.351, range=0..1),
    Color=ColourSwatch(SwatchColor=RGB(0, 0, 0)),
    HorizontalAlignment="0",
    VerticalAlginment=1,
    Font="Verdana",
    UseMeshes=False,
    Bake=False)
justified_text_7 = JustifiedText3d(
    Location=vector_xyz_2.Vector,
    Text="General information:",
    Size=Slider(0.455, range=0..1),
    Color=ColourSwatch(SwatchColor=RGB(0, 0, 0)),
    HorizontalAlignment="0",
    VerticalAlginment=1,
    Font="Verdana",
    UseMeshes=False,
    Bake=False)
vector_xyz_5 = VectorXYZ(XComponent=Slider(0, range=-1..1), YComponent=Slider(-3.2, range=-10..1), ZComponent=0)  # -> Vector, Length
concatenate_13 = Concatenate(Fragment_A="Dimension: ", Fragment_B=panel_9, A=" x ", B=panel_10, C=" meters")
vector_xyz_6 = VectorXYZ(XComponent=Slider(0, range=-1..1), YComponent=Slider(-3.8, range=-10..1), ZComponent=0)  # -> Vector, Length
justified_text_8 = JustifiedText3d(
    Location=vector_xyz_5.Vector,
    Text=concatenate_13,
    Size=Slider(0.351, range=0..1),
    Color=ColourSwatch(SwatchColor=RGB(0, 0, 0)),
    HorizontalAlignment="0",
    VerticalAlginment=1,
    Font="Verdana",
    UseMeshes=False,
    Bake=False)

# ----
# Windows
data_25 = Data(flatten(join_curves))
deconstruct_brep = DeconstructBrep(Brep=data_25)  # -> Faces, Edges, Vertices
region_union = RegionUnion(Curves=data_25)
data_26 = Data(deconstruct_brep.Vertices)
data_27 = Data(region_union)
pull_point_3 = PullPoint(Point=data_26, Geometry=region_union, ClosestOnly=True)  # -> ClosestPoint, Distance, Index
deconstruct_brep_2 = DeconstructBrep(Brep=data_27)  # -> Faces, Edges, Vertices
boolean_2 = Boolean(pull_point_3.Distance)
data_28 = Data(deconstruct_brep_2.Vertices)
dispatch_9 = Dispatch(List=data_26, DispatchPattern=boolean_2)  # -> ListA, ListB
data_29 = Data(dispatch_9.ListB)
merge_5 = Merge(Data1=data_28, Data2=data_29)  # -> flatten(Result)
curve_closest_point_4 = CurveClosestPoint(Point=merge_5, Curve=region_union)  # -> Point, Parameter, Distance
shatter_4 = Shatter(Curve=region_union, Parameters=curve_closest_point_4.Parameter)
curve_middle_2 = CurveMiddle(Curve=shatter_4)
pull_point_4 = PullPoint(Point=curve_middle_2, Geometry=join_curves, ClosestOnly=True)  # -> ClosestPoint, Distance, Index
boolean_3 = Boolean(invert(pull_point_4.Distance))
dispatch_multiple = DispatchMultiple(DispatchPattern=boolean_3, ListList0=shatter_4)
dispatch_multiple_2 = DispatchMultiple(DispatchPattern=boolean_3, ListList0=curve_middle_2)
length_3 = Length(Curve=dispatch_multiple)
sort_list_2 = SortList(Keys=length_3, ValuesValuesA=dispatch_multiple_2)  # -> Keys, reverse(ValuesValuesA)
sort_list_3 = SortList(Keys=length_3, ValuesValuesA=dispatch_multiple)  # -> Keys, reverse(ValuesValuesA)
python_3_script_3 = Python3Script(x=flatten(room_names), y=flatten(panel_16))  # -> out, a; inputs x: list, y: list
# ---------- python_3_script_3: Python ----------
special_rooms = y
mask = len(x)*[1]
print(mask)
for i, room in enumerate(x):
    print(room)
    if room in special_rooms:
        mask[i] = 0

a = mask
# ---------- end python_3_script_3 ----------
panel_87 = Panel("""0
1""")
list_item_47 = ListItem(List=sort_list_2.ValuesValuesA, Index=panel_87, Wrap=True)
length_4 = Length(Curve=sort_list_3.ValuesValuesA)
smaller_than_6 = SmallerThan(FirstNumber=length_4, SecondNumber=expr("x*2", "0.6"))  # -> SmallerThan, OrEqualTo
dispatch_10 = Dispatch(List=list_item_47, DispatchPattern=smaller_than_6.SmallerThan)  # -> ListA, ListB
dispatch_11 = Dispatch(List=simplify(dispatch_10.ListB), DispatchPattern=graft(python_3_script_3.a))  # -> ListA, ListB

panel_88 = Panel(python_3_script_3.a)

data_30 = Data(simplify(dispatch_3.ListB))
curve_middle_3 = CurveMiddle(Curve=data_30)
pull_point_5 = PullPoint(Point=flatten(curve_middle_3), Geometry=region_union, ClosestOnly=True)  # -> ClosestPoint, Distance, Index
boolean_4 = Boolean(pull_point_5.Distance)
dispatch_12 = Dispatch(List=flatten(data_30), DispatchPattern=boolean_4)  # -> ListA, ListB
data_31 = Data(dispatch_12.ListA)
merge_6 = Merge(Data1=data_7, Data2=data_31)  # -> flatten(Result)

# ---- group: Windows location
data_32 = Data(dispatch_11.ListA)

# ----
circle_5 = Circle(Plane=data_32, Radius="0.6")
curve_curve_8 = CurveCurve(CurveA=circle_5, CurveB=join_curves)  # -> simplify(Points), ParamsA, ParamsB
split_list_4 = SplitList(List=curve_curve_8.Points, Index="1")  # -> ListA, ListB
line_4 = Line(StartPoint=split_list_4.ListA, EndPoint=split_list_4.ListB)

curve_curve_9 = CurveCurve(CurveA=flatten(line_4), CurveB=region_union)  # -> Points, ParamsA, ParamsB
curve_closest_point_5 = CurveClosestPoint(Point=curve_curve_9.Points, Curve=region_union)  # -> Point, Parameter, Distance
shatter_5 = Shatter(Curve=region_union, Parameters=flatten(curve_closest_point_5.Parameter))
curve_middle_4 = CurveMiddle(Curve=shatter_5)
pull_point_6 = PullPoint(Point=curve_middle_4, Geometry=flatten(line_4), ClosestOnly=True)  # -> ClosestPoint, Distance, Index
boolean_5 = Boolean(pull_point_6.Distance)
dispatch_13 = Dispatch(List=shatter_5, DispatchPattern=boolean_5)  # -> ListA, ListB

# ---- group: Interior walls
move_8 = Move(Geometry=merge_6, Motion=vector_2pt.Vector)  # -> Geometry, Transform
custom_preview_lineweights_3 = CustomPreviewLineweights(
    Geometry=flatten(move_8.Geometry),
    Shader=ColourSwatch(SwatchColor=RGB(0, 0, 0)),
    Thickness=Slider(0.1, range=0..10),
    Absolute="True")

# ---- group: Interior walls representation
custom_preview_lineweights_4 = CustomPreviewLineweights(
    Geometry=flatten(merge_6),
    Shader=ColourSwatch(SwatchColor=RGB(0, 0, 0)),
    Thickness=Slider(0.1, range=0..10),
    Absolute="True")

# ---- group: Walls without windows
data_33 = Data(dispatch_13.ListA)

# ---- group: Exterior walls
move_9 = Move(Geometry=data_33, Motion=vector_2pt.Vector)  # -> Geometry, Transform
custom_preview_lineweights_5 = CustomPreviewLineweights(
    Geometry=flatten(move_9.Geometry),
    Shader=ColourSwatch(SwatchColor=RGB(0, 0, 0)),
    Thickness=Slider(0.2, range=0..10),
    Absolute="True")

# ---- group: Exterior walls representation
custom_preview_lineweights_6 = CustomPreviewLineweights(
    Geometry=flatten(data_33),
    Shader=ColourSwatch(SwatchColor=RGB(0, 0, 0)),
    Thickness=Slider(0.2, range=0..10),
    Absolute="True")

# ---- group: External Walls
data_34 = Data(dispatch_12.ListB)

# ---- group: Interior Walls
data_35 = Data([data_6, data_31])

# ----
# Area info
number_slider_3 = Slider(-0.4, range=-1..1)
area_7 = Area(Geometry=join_curves)  # -> flatten(Area), Centroid
unit_y_2 = UnitY(Factor=1)
brep_2 = Brep(move.Geometry)
area_8 = Area(Geometry=brep_2)  # -> Area, Centroid
format = Format(Format="{0:0.00}", Culture=127, Data0=area_7.Area)
amplitude = Amplitude(Vector=unit_y_2, Amplitude=number_slider_3)
move_10 = Move(Geometry=area_8.Centroid, Motion=amplitude)  # -> Geometry, Transform
mass_addition_26 = MassAddition(Input=format)  # -> Result, PartialResults
concat = Concatenate(FragmentD=format, FragmentE="m²")
concat_2 = Concatenate(FragmentA="The ", FragmentB=room_names, FragmentC=" has ", FragmentD=format, FragmentE="m².")  # -> graft(Result)
justified_text_9 = JustifiedText3d(
    Location=move_10.Geometry,
    Text=concat,
    Size=Slider(0.172, range=0..1),
    Color=ColourSwatch(SwatchColor=RGB(0, 0, 0)),
    HorizontalAlignment=1,
    VerticalAlginment=1,
    Font="Verdana",
    UseMeshes=False,
    Bake=False)
panel_89 = Panel(concat_2)

round_4 = Round(Number=mass_addition_26.Result)  # -> Nearest, Floor, Ceiling

final_area = Panel(round_4.Nearest)

concatenate_14 = Concatenate(Fragment_A="Total area: ", Fragment_B=final_area, A="m²")
justified_text_10 = JustifiedText3d(
    Location=vector_xyz_6.Vector,
    Text=concatenate_14,
    Size=Slider(0.351, range=0..1),
    Color=ColourSwatch(SwatchColor=RGB(0, 0, 0)),
    HorizontalAlignment="0",
    VerticalAlginment=1,
    Font="Verdana",
    UseMeshes=False,
    Bake=False)

rooms_final_area = Panel(format)
panel_90 = Panel(room_names)
smaller_than_7 = SmallerThan(FirstNumber=rooms_final_area, SecondNumber=python_3_script_2.areas_max)  # -> SmallerThan, OrEqualTo
larger_than_3 = LargerThan(FirstNumber=rooms_final_area, SecondNumber=python_3_script_2.areas_min)  # -> LargerThan, OrEqualTo
area_max = Panel(python_3_script_2.areas_max)
area_min = Panel(python_3_script_2.areas_min)
gate_and_2 = GateAnd(A=larger_than_3.LargerThan, B=smaller_than_7.SmallerThan)
panel_91 = Panel(gate_and_2)

# ---- group: Room area
move_11 = Move(Geometry=brep_2, Motion=vector_2pt.Vector)  # -> Geometry, Transform
unit_y_3 = UnitY(Factor=1)
area_9 = Area(Geometry=move_11.Geometry)  # -> Area, Centroid
amplitude_2 = Amplitude(Vector=unit_y_3, Amplitude=Slider(-0.4, range=-1..1))
move_12 = Move(Geometry=area_9.Centroid, Motion=amplitude_2)  # -> Geometry, Transform
concat_3 = Concatenate(FragmentD=format, FragmentE="m²")
justified_text_11 = JustifiedText3d(
    Location=move_12.Geometry,
    Text=concat_3,
    Size=Slider(0.172, range=0..1),
    Color=ColourSwatch(SwatchColor=RGB(0, 0, 0)),
    HorizontalAlignment=1,
    VerticalAlginment=1,
    Font="Verdana",
    UseMeshes=False,
    Bake=False)

# ----
panel_92 = Panel(py3_6.clean_names)
trim_tree_3 = TrimTree(Tree=line_4, Depth=1)
trim_tree_4 = TrimTree(Tree=trim_tree_3, Depth=1)
evaluate = Evaluate(Expression="x<>\"foyer\"", x=graft(panel_92))
removeduplicatelines = RemoveDuplicateLines(Lines=trim_tree_4, Tolerance=0.01)  # -> simplify(UniqueLines)
boolean_6 = Boolean(invert(flatten(evaluate)))
tree_statistics = TreeStatistics(Tree=removeduplicatelines)  # -> Paths, Length, Count
dispatch_14 = Dispatch(List=tree_statistics.Paths, DispatchPattern=boolean_6)  # -> ListA, ListB
tree_branch = TreeBranch(Tree=removeduplicatelines, Path=dispatch_14.ListB, MaintainPaths=True)
tree_branch_2 = TreeBranch(Tree=removeduplicatelines, Path=dispatch_14.ListA, MaintainPaths=True)
list_item_48 = ListItem(List=tree_branch_2, Index="0", Wrap=True)  # -> Item, Item1

# ---- group: Windows
data_36 = Data([tree_branch, list_item_48.Item1])

# ---- group: Entrance door
data_37 = Data(list_item_48.Item)

# ---- group: Window representation
custom_preview_lineweights_7 = CustomPreviewLineweights(
    Geometry=flatten(data_36),
    Shader=ColourSwatch(SwatchColor=RGB(0, 0, 0)),
    Thickness=Slider(0.07, range=0..10),
    Absolute="True")

# ----
end_points_3 = EndPoints(Curve=graft(data_37))  # -> Start, End
length_5 = Length(Curve=graft(data_37))
perp_frame_2 = PerpFrame(Curve=graft(data_37), Parameter="0")
data_38 = Data(end_points_3.End)
deconstruct_plane_2 = DeconstructPlane(Plane=perp_frame_2)  # -> Origin, XAxis, YAxis, ZAxis
reverse_2 = Reverse(Vector=deconstruct_plane_2.YAxis)
line_sdl_2 = LineSDL(Start=deconstruct_plane_2.Origin, Direction=reverse_2, Length=length_5)
circle_6 = Circle(Plane=deconstruct_plane_2.Origin, Radius=length_5)
end_points_4 = EndPoints(Curve=line_sdl_2)  # -> Start, End
data_39 = Data(end_points_4.End)
merge_7 = Merge(Data1=data_39, Data2=data_38)
curve_closest_point_6 = CurveClosestPoint(Point=merge_7, Curve=circle_6)  # -> Point, Parameter, Distance
shatter_6 = Shatter(Curve=circle_6, Parameters=curve_closest_point_6.Parameter)
length_6 = Length(Curve=shatter_6)
sort_list_4 = SortList(Keys=length_6, ValuesValuesA=shatter_6)  # -> Keys, ValuesValuesA
list_item_49 = ListItem(List=sort_list_4.ValuesValuesA, Index=0, Wrap=True)
merge_8 = Merge(Data1=line_sdl_2, Data2=list_item_49, Data3=data_37)
data_40 = Data(merge_8)

# ---- group: Entrance door
move_13 = Move(Geometry=data_40, Motion=vector_2pt.Vector)  # -> Geometry, Transform
custom_preview_lineweights_8 = CustomPreviewLineweights(
    Geometry=flatten(move_13.Geometry),
    Shader=ColourSwatch(SwatchColor=RGB(0, 0, 0)),
    Thickness=Slider(0.05, range=0..10),
    Absolute="True")

# ---- group: Doors representation
custom_preview_lineweights_9 = CustomPreviewLineweights(
    Geometry=flatten([data_4, data_40]),
    Shader=ColourSwatch(SwatchColor=RGB(0, 0, 0)),
    Thickness=Slider(0.05, range=0..10),
    Absolute="True")

# ----
data_41 = Data(end_points_3.Start)

# ---- group: Entrance door
data_42 = Data(data_37)

# ---- group: Windows
data_43 = Data(data_36)

move_14 = Move(Geometry=data_43, Motion=vector_2pt.Vector)  # -> Geometry, Transform
custom_preview_lineweights_10 = CustomPreviewLineweights(
    Geometry=flatten(move_14.Geometry),
    Shader=ColourSwatch(SwatchColor=RGB(0, 0, 0)),
    Thickness=Slider(0.07, range=0..10),
    Absolute="True")

# ----
panel_93 = Panel(data_36)
tree_statistics_2 = TreeStatistics(Tree=panel_93)  # -> Paths, Length, Count
windows_as_lines = Data(flatten(data_43))
curve_middle_5 = CurveMiddle(Curve=windows_as_lines)  # -> flatten(Midpoint)
evaluate_curve_2 = EvaluateCurve(Curve=windows_as_lines, Parameter=Slider(0.5, range=0..1))  # -> Point, Tangent, Angle
windows_as_lines_2 = Data(flatten(data_42))
curve_middle_6 = CurveMiddle(Curve=windows_as_lines_2)  # -> flatten(Midpoint)
evaluate_curve_3 = EvaluateCurve(Curve=windows_as_lines_2, Parameter=Slider(0.5, range=0..1))  # -> Point, Tangent, Angle

# ----
# 3D Visualization
wall = Slider(0.2, range=0..1)
height = Slider(3, range=0..3)
join_curves_3 = JoinCurves(Curves=data_34, Preserve=False)
unit_z = UnitZ(Factor=height)
data_44 = Data([data_8, data_42])
division_25 = Division(A=wall, B=3)
division_26 = Division(A=wall, B=2)
division_27 = Division(A=wall, B="2")
negative_4 = Negative(Value=division_27)
move_15 = Move(Geometry=join_curves_3, Motion=unit_z)  # -> Geometry, Transform
division_28 = Division(A=wall, B="2")
addition = Addition(A=division_25, B=division_26)
negative_5 = Negative(Value=division_28)
negative_6 = Negative(Value=addition)
offset_curve_5 = OffsetCurve(Curve=join_curves_3, Distance=division_27, Corners=1)
offset_curve_6 = OffsetCurve(Curve=join_curves_3, Distance=negative_4, Corners=1)
offset_curve_7 = OffsetCurve(Curve=data_35, Distance=division_28, Corners=1)
offset_curve_8 = OffsetCurve(Curve=data_35, Distance=negative_5, Corners=1)
offset_curve_9 = OffsetCurve(Curve=data_44, Distance=addition, Corners=1)
offset_curve_10 = OffsetCurve(Curve=data_44, Distance=negative_6, Corners=1)
floor_tickness = Slider(0.2, range=0..3)
addition_2 = Addition(A=division_25, B=division_26)
floor_tickness_2 = Slider(0.2, range=0..3)
graft_tree = GraftTree(Tree=offset_curve_5, IncludeEmptyLists=True, IncludeNullItems=True)
graft_tree_2 = GraftTree(Tree=offset_curve_6, IncludeEmptyLists=True, IncludeNullItems=True)
graft_tree_3 = GraftTree(Tree=offset_curve_7, IncludeEmptyLists=True, IncludeNullItems=True)
graft_tree_4 = GraftTree(Tree=offset_curve_8, IncludeEmptyLists=True, IncludeNullItems=True)
graft_tree_5 = GraftTree(Tree=offset_curve_9, IncludeEmptyLists=True, IncludeNullItems=True)
graft_tree_6 = GraftTree(Tree=offset_curve_10, IncludeEmptyLists=True, IncludeNullItems=True)
door_height = Slider(2.1, range=0..3)
unit_z_2 = UnitZ(Factor=floor_tickness)
loft = Loft(
    Curves=[graft_tree, graft_tree_2],
    Options={Adjust=False, Closed=False, LoftEnds=0, LoftSimp=0, LoftType=0, Rebuild=10, Refit=0.01})
loft_2 = Loft(
    Curves=[graft_tree_3, graft_tree_4],
    Options={Adjust=False, Closed=False, LoftEnds=0, LoftSimp=0, LoftType=0, Rebuild=10, Refit=0.01})
loft_3 = Loft(
    Curves=[graft_tree_5, graft_tree_6],
    Options={Adjust=False, Closed=False, LoftEnds=0, LoftSimp=0, LoftType=0, Rebuild=10, Refit=0.01})
unit_z_3 = UnitZ(Factor=door_height)
unit_z_4 = UnitZ(Factor=door_height)
unit_z_5 = UnitZ(Factor=floor_tickness_2)
unit_z_6 = UnitZ(Factor=Slider(3, range=0..10))
negative_7 = Negative(Value=unit_z_2)
merge_faces = MergeFaces(Brep=loft_2)  # -> Breps, Before, After
move_16 = Move(Geometry=data_43, Motion=unit_z_3)  # -> Geometry, Transform
merge_faces_2 = MergeFaces(Brep=loft)  # -> Breps, Before, After
extrude = Extrude(Base=loft_3, Direction=unit_z_4)
offset_curve_11 = OffsetCurve(Curve=move_16.Geometry, Distance=addition_2, Corners=1)
offset_curve_12 = OffsetCurve(Curve=move_16.Geometry, Distance=negative_6, Corners=1)
window_height = Slider(1.2, range=0..3)
region_union_2 = RegionUnion(Curves=flatten(merge_faces.Breps))
graft_tree_7 = GraftTree(Tree=offset_curve_11, IncludeEmptyLists=True, IncludeNullItems=True)
graft_tree_8 = GraftTree(Tree=offset_curve_12, IncludeEmptyLists=True, IncludeNullItems=True)
boundary_surfaces_5 = BoundarySurfaces(Edges=region_union_2)
unit_z_7 = UnitZ(Factor=window_height)
loft_4 = Loft(
    Curves=[graft_tree_7, graft_tree_8],
    Options={Adjust=False, Closed=False, LoftEnds=0, LoftSimp=0, LoftType=0, Rebuild=10, Refit=0.01})
extrude_2 = Extrude(Base=merge_faces_2.Breps, Direction=unit_z_6)
extrude_3 = Extrude(Base=boundary_surfaces_5, Direction=unit_z_6)
negative_8 = Negative(Value=unit_z_7)
solid_difference = SolidDifference(BrepsA=flatten(extrude_3), BrepsB=extrude_2)
extrude_4 = Extrude(Base=loft_4, Direction=negative_8)  # -> flatten(Extrusion)
relay = Relay([extrude_2, solid_difference])
solid_difference_2 = SolidDifference(BrepsA=solid_difference, BrepsB=flatten(extrude))
solid_difference_3 = SolidDifference(BrepsA=extrude_2, BrepsB=flatten([extrude, extrude_4]))

# ---- group: Roof
offset_curve_13 = OffsetCurve(Curve=move_15.Geometry, Distance=division_27, Corners=1)

# ---- group: Floor
offset_curve_14 = OffsetCurve(Curve=join_curves_3, Distance=division_27, Corners=1)

# ----
boundary_surfaces_6 = BoundarySurfaces(Edges=offset_curve_13)
boundary_surfaces_7 = BoundarySurfaces(Edges=offset_curve_14)
extrude_5 = Extrude(Base=boundary_surfaces_6, Direction=unit_z_5)
extrude_6 = Extrude(Base=boundary_surfaces_7, Direction=negative_7)

# ----
# 3D Representation
door_window_tickness = Slider(0.05, range=0..1)
division_29 = Division(A=door_window_tickness, B=2)
negative_9 = Negative(Value=division_29)
window_height_2 = Slider(1.2, range=0..3)
offset_curve_15 = OffsetCurve(Curve=data_44, Distance=division_29, Corners=1)
offset_curve_16 = OffsetCurve(Curve=data_44, Distance=negative_9, Corners=1)
offset_curve_17 = OffsetCurve(Curve=move_16.Geometry, Distance=division_29, Corners=1)
offset_curve_18 = OffsetCurve(Curve=move_16.Geometry, Distance=negative_9, Corners=1)
graft_tree_9 = GraftTree(Tree=offset_curve_15, IncludeEmptyLists=True, IncludeNullItems=True)
graft_tree_10 = GraftTree(Tree=offset_curve_16, IncludeEmptyLists=True, IncludeNullItems=True)
graft_tree_11 = GraftTree(Tree=offset_curve_17, IncludeEmptyLists=True, IncludeNullItems=True)
graft_tree_12 = GraftTree(Tree=offset_curve_18, IncludeEmptyLists=True, IncludeNullItems=True)
unit_z_8 = UnitZ(Factor=window_height_2)
door_height_2 = Slider(2.1, range=0..3)
loft_5 = Loft(
    Curves=[graft_tree_9, graft_tree_10],
    Options={Adjust=False, Closed=False, LoftEnds=0, LoftSimp=0, LoftType=0, Rebuild=10, Refit=0.01})
loft_6 = Loft(
    Curves=[graft_tree_11, graft_tree_12],
    Options={Adjust=False, Closed=False, LoftEnds=0, LoftSimp=0, LoftType=0, Rebuild=10, Refit=0.01})
negative_10 = Negative(Value=unit_z_8)
unit_z_9 = UnitZ(Factor=door_height_2)
extrude_7 = Extrude(Base=loft_5, Direction=unit_z_9)  # -> flatten(Extrusion)
extrude_8 = Extrude(Base=loft_6, Direction=negative_10)
solid_intersection = SolidIntersection(BrepsA=extrude_2, BrepsB=flatten(extrude_8))
solid_intersection_2 = SolidIntersection(BrepsA=relay, BrepsB=extrude_7)
rotate = Rotate(Geometry=solid_intersection_2, Angle=Slider(0, range=0..2), Plane=[deconstruct_plane.Origin, data_41])  # -> Geometry, Transform

boundary = Data(flatten(join_curves_3))
polygon_center = PolygonCenter(Polyline=boundary)  # -> CenterV, CenterE, CenterA

# ---- group: Roof - 3D
preview_4 = CustomPreview(Geometry=extrude_5, Material=ColourSwatch(SwatchColor=RGB(204, 204, 204)))

# ---- group: Walls - 3D
preview_5 = CustomPreview(Geometry=[solid_difference_3, solid_difference_2], Material=ColourSwatch(SwatchColor=RGB(204, 204, 204)))

# ---- group: Floor - 3D
preview_6 = CustomPreview(Geometry=extrude_6, Material=ColourSwatch(SwatchColor=RGB(204, 204, 204)))

# ----
vector_2pt_5 = Vector2Pt(PointA=polygon_center.CenterA, PointB=evaluate_curve_2.Point, Unitize=Slider(0.06, range=0..1))  # -> Vector, Length
move_17 = Move(Geometry=curve_middle_5, Motion=vector_2pt_5.Vector)  # -> Geometry, Transform
polygon_center_2 = PolygonCenter(Polyline=boundary)  # -> CenterV, CenterE, CenterA
vector_2pt_6 = Vector2Pt(PointA=polygon_center_2.CenterA, PointB=evaluate_curve_3.Point, Unitize=Slider(0.06, range=0..1))  # -> Vector, Length
move_18 = Move(Geometry=curve_middle_6, Motion=vector_2pt_6.Vector)  # -> Geometry, Transform

composite = Composite()
composite_2 = Composite()
data_45 = Data(offset_curve_14)
wallsetc = WallSettingsComposite(Composite=composite_2, Composite_2=composite_2, AC_ActiveState_Name="SC_CompositeSlantedCRL")
wallsetc_2 = WallSettingsComposite(Composite=composite, Composite_2=composite, AC_ActiveState_Name="SC_CompositeSlantedCRL")
offset_curve_19 = OffsetCurve(Curve=data_45, Distance=Slider(0.05, range=0..1), Corners=1)
composite_3 = Composite()
wall_2 = Wall(Synchronize=True, Curve=boundary, WallSettings=wallsetc)  # -> flatten(Wall)
wall_3 = Wall(Synchronize=True, Curve=data_35, WallSettings=wallsetc_2)  # -> flatten(Wall)
slabsetc = SlabSettingsComposite(Composite=composite_3, Composite_2=composite_3, AC_ActiveState_Name="Composite")
slab = Slab(Synchronize=True, Polygon=offset_curve_19, SlabSettings=slabsetc)
# Archicad
door_point = DoorPoint(
    Synchronize=Toggle(True),
    Wall=wall_3,
    InsertionPoint=curve_middle_6,
    Orientation=move_18.Geometry,
    RevealSide=True,
    AC_Door_Point=(2, 0, 0))

# ---- group: Windows - 3D
create_material = CreateMaterial(
    Diffuse=ColourSwatch(SwatchColor=RGB(159, 182, 189)),
    Specular=RGB(255, 255, 255),
    Emission=RGB(0, 0, 0),
    Transparency=Slider(0.42, range=0..1),
    Shine=0)
preview_7 = CustomPreview(Geometry=solid_intersection, Material=create_material)

# ----
window_point = WindowPoint(
    Synchronize=Toggle(False),
    Wall=wall_2,
    InsertionPoint=flatten(curve_middle_5),
    Orientation=move_17.Geometry,
    RevealSide=True,
    WindowSettings=window_settings.WindowSettings,
    AC_Window_Point=(2, 0, 0))

# ---- group: Doors - 3D
preview_8 = CustomPreview(Geometry=rotate.Geometry, Material=ColourSwatch(SwatchColor=RGB(145, 129, 93)))

# ----
# Extracting information
# for validation process
region_union_3 = RegionUnion(Curves=boundary_surfaces_2)
join_curves_4 = JoinCurves(Curves=data_4, Preserve=False)  # -> simplify(flatten(Curves))
boundary_surfaces_8 = BoundarySurfaces(Edges=join_curves_4)
region_difference = RegionDifference(CurvesA=region_union_3, CurvesB=rectangle_2.Rectangle)
area_10 = Area(Geometry=boundary_surfaces_8)  # -> Area, Centroid
area_11 = Area(Geometry=region_difference)  # -> Area, Centroid
data_46 = Data(flatten(line_sdl))
data_47 = Data(flatten(data_36))
reference_list = Panel(rooms)
shuffled_list = Panel(py3_6.clean_names)
requested_windows = Panel(windows_count)
shuffled_windows = Panel(tree_statistics_2.Length)
requested_sun_hours_summer = Panel(panel_3)
shuffled_sun_hours_summer = Panel(output_sun_hours_summer)
requested_sun_hours_winter = Panel(panel_4)
requested_noise_level = Panel(panel_5)
shuffled_sun_hours_winter = Panel(output_sun_hours_winter)
shuffled_noise_level = Panel(panel_60)
doors_area = Panel(area_10.Area)
panel_94 = Panel(data_47)
panel_95 = Panel(data_37)
panel_96 = Panel(data_46)
panel_97 = Panel(data_33)
panel_98 = Panel(merge_6)
excess_area = Panel(area_11.Area)
python_3_script_4 = Python3Script(
    reference_list=reference_list,
    shuffled_list=shuffled_list,
    requested_noise_level=requested_noise_level,
    shuffled_noise_level=shuffled_noise_level,
    requested_sun_hours_s=requested_sun_hours_summer,
    shuffled_sun_hours_s=shuffled_sun_hours_summer,
    requested_sun_hours_w=requested_sun_hours_winter,
    shuffled_sun_hours_w=shuffled_sun_hours_winter)  # -> out, ordered_rooms, ordered_output_noise, ordered_output_sun_hours_s, ordered_output_sun_hours_w; inputs reference_list: list, shuffled_list: list, requested_noise_level: list, shuffled_noise_level: list, requested_sun_hours_s: list, shuffled_sun_hours_s: list, requested_sun_hours_w: list, shuffled_sun_hours_w: list
# ---------- python_3_script_4: Python ----------
# Dados de entrada para noise e sun hours
reference_list = reference_list
shuffled_list = shuffled_list
requested_noise_level = requested_noise_level
shuffled_noise_level = shuffled_noise_level
requested_sun_hours_s = requested_sun_hours_s
shuffled_sun_hours_s = shuffled_sun_hours_s
requested_sun_hours_w = requested_sun_hours_w
shuffled_sun_hours_w = shuffled_sun_hours_w

# Criar dicionários mapeando room para valores
room_to_noise = dict(zip(shuffled_list, requested_noise_level))
room_to_output_noise = dict(zip(shuffled_list, shuffled_noise_level))

room_to_summer = dict(zip(shuffled_list, requested_sun_hours_s))
room_to_output_summer = dict(zip(shuffled_list, shuffled_sun_hours_s))

room_to_winter = dict(zip(shuffled_list, requested_sun_hours_w))
room_to_output_winter = dict(zip(shuffled_list, shuffled_sun_hours_w))

# Função auxiliar para pegar valor ou "null"
def get_value(d, key):
    return d.get(key, "null")

# Lista ordenada de rooms
ordered_rooms = []
ordered_req_noise = []
ordered_output_noise = []
ordered_req_sun_hours_s = []
ordered_output_sun_hours_s = []
ordered_req_sun_hours_w = []
ordered_output_sun_hours_w = []

# Preenchendo listas
for room in reference_list:
    ordered_rooms.append(room if room in shuffled_list else "null")

    ordered_req_noise.append(get_value(room_to_noise, room))
    ordered_output_noise.append(get_value(room_to_output_noise, room))

    ordered_req_sun_hours_s.append(get_value(room_to_summer, room))
    ordered_output_sun_hours_s.append(get_value(room_to_output_summer, room))

    ordered_req_sun_hours_w.append(get_value(room_to_winter, room))
    ordered_output_sun_hours_w.append(get_value(room_to_output_winter, room))

# Resultados
print("Ordered Rooms:", ordered_rooms)
print("Ordered Output Noise Levels:", ordered_output_noise)
print("Ordered Sun Hours Summer:", ordered_output_sun_hours_s)
print("Ordered Sun Hours Winter:", ordered_output_sun_hours_w)
# ---------- end python_3_script_4 ----------
replace_nulls = ReplaceNulls(Items=flatten(panel_94), Replacements="null")  # -> Items, Count
replace_nulls_2 = ReplaceNulls(Items=flatten(panel_95), Replacements="null")  # -> Items, Count
replace_nulls_3 = ReplaceNulls(Items=flatten(panel_96), Replacements="null")  # -> Items, Count
replace_nulls_4 = ReplaceNulls(Items=flatten(panel_97), Replacements="null")  # -> Items, Count
replace_nulls_5 = ReplaceNulls(Items=flatten(panel_98), Replacements="null")  # -> Items, Count
python_3_script_5 = Python3Script(excess_area=excess_area)  # -> out, answer; inputs excess_area: list
# ---------- python_3_script_5: Python ----------
excess_area = excess_area

if not excess_area or len(excess_area) == 0:
    status = "No"
else:
    status = f"Yes"

answer = status
# ---------- end python_3_script_5 ----------
door_opening_area = Panel("0.502655")
python_3_script_6 = Python3Script(entrance_door=replace_nulls_2.Items)  # -> out, answer; inputs entrance_door: list
# ---------- python_3_script_6: Python ----------
entrance_door = entrance_door

if not entrance_door or "null" in entrance_door:
    status = "No"
else:
    status = f"Yes"

answer = status
# ---------- end python_3_script_6 ----------
python_3_script_7 = Python3Script(interior_doors=replace_nulls_3.Items)  # -> out, answer; inputs interior_doors: list
# ---------- python_3_script_7: Python ----------
interior_doors = interior_doors

if not interior_doors or "null" in interior_doors:
    status = "No"
else:
    status = f"Yes"

answer = status
# ---------- end python_3_script_7 ----------
python_3_script_8 = Python3Script(exterior_walls=replace_nulls_4.Items)  # -> out, answer; inputs exterior_walls: list
# ---------- python_3_script_8: Python ----------
exterior_walls = exterior_walls

if not exterior_walls  or "null" in exterior_walls:
    status = "No"
else:
    status = f"Yes"

answer = status
# ---------- end python_3_script_8 ----------
python_3_script_9 = Python3Script(interior_walls=replace_nulls_5.Items)  # -> out, answer; inputs interior_walls: list
# ---------- python_3_script_9: Python ----------
interior_walls = interior_walls

if not interior_walls  or "null" in interior_walls:
    status = "No"
else:
    status = f"Yes"

answer = status
# ---------- end python_3_script_9 ----------
python_3_script_10 = Python3Script(area_ref=door_opening_area, areas=doors_area)  # -> out, answer; inputs areas: list
# ---------- python_3_script_10: Python ----------
answer = "No"
for a in areas:
    if a != area_ref:
        answer = "Yes"
        break
# ---------- end python_3_script_10 ----------
python_3_script_11 = Python3Script(windows=replace_nulls.Items)  # -> out, answer; inputs windows: list
# ---------- python_3_script_11: Python ----------
windows = windows

if not windows  or "null" in windows:
    status = "No"
else:
    status = f"Yes"

answer = status
# ---------- end python_3_script_11 ----------
requested_windows_2 = Panel(requested_windows)
output_noise_level = Panel(python_3_script_4.ordered_output_noise)
output_sun_hours_summer_2 = Panel(python_3_script_4.ordered_output_sun_hours_s)
requested_sun_hours_winter_2 = Panel(requested_sun_hours_winter)
is_the_entrance_door_being_exported = Panel(python_3_script_6.answer)
layout_option = Panel(panel_7)
requested_area_2 = Panel(requested_area)
final_area_2 = Panel(final_area)
requested_rooms = Panel(reference_list)
output_rooms = Panel(python_3_script_4.ordered_rooms)
output_sun_hours_winter_2 = Panel(python_3_script_4.ordered_output_sun_hours_w)
it_has_excess_area = Panel(python_3_script_5.answer)
are_the_windows_being_exported = Panel(python_3_script_11.answer)
are_the_interior_doors_being_exported = Panel(python_3_script_7.answer)
are_the_exterior_walls_being_exported = Panel(python_3_script_8.answer)
are_the_interior_walls_being_exported = Panel(python_3_script_9.answer)
requested_noise_level_2 = Panel(requested_noise_level)
requested_sun_hours_summer_2 = Panel(requested_sun_hours_summer)
door_connecting_problem = Panel(python_3_script_10.answer)
panel_99 = Panel("E:\MESTRADO\BIM A+\00\MODULO 7 - DISSERTATION\Rhino_Grasshopper\info_extraction\prompt_2.4\json\")
concatenate_15 = Concatenate(Fragment_A=panel_99, Fragment_B="floorplan_", A=layout_options, B=".json")

python_3_script_12 = Python3Script(
    reference_list=reference_list,
    shuffled_list=shuffled_list,
    requested_windows=requested_windows,
    shuffled_windows=shuffled_windows)  # -> out, ordered_output_windows; inputs reference_list: list, shuffled_list: list, requested_windows: list, shuffled_windows: list
# ---------- python_3_script_12: Python ----------
# Dados de entrada para janelas
reference_list = reference_list
shuffled_list = shuffled_list
requested_windows = requested_windows
shuffled_windows = shuffled_windows

# Criar dicionários mapeando room para valores de janelas
room_to_windows = dict(zip(shuffled_list, requested_windows))
room_to_output_windows = dict(zip(shuffled_list, shuffled_windows))

# Função auxiliar para pegar valor ou "null"
def get_value(d, key):
    return d.get(key, "null")

# Listas ordenadas para janelas
ordered_rooms = []
ordered_req_windows = []
ordered_output_windows = []

# Preenchendo listas de janelas
for room in reference_list:
    ordered_rooms.append(room if room in shuffled_list else "null")
    ordered_req_windows.append(get_value(room_to_windows, room))
    ordered_output_windows.append(get_value(room_to_output_windows, room))

# Resultados janelas
print("Ordered Output Windows:", ordered_output_windows)
# ---------- end python_3_script_12 ----------

output_windows = Panel(python_3_script_12.ordered_output_windows)
python_3_script_13 = Python3Script(
    save_path=concatenate_15,
    layout_option=layout_option,
    requested_area=requested_area_2,
    final_area=final_area_2,
    requested_rooms=requested_rooms,
    output_rooms=output_rooms,
    requested_windows=requested_windows_2,
    output_windows=output_windows,
    requested_noise_level=requested_noise_level_2,
    output_noise_level=output_noise_level,
    requested_sun_hours_s=requested_sun_hours_summer_2,
    output_sun_hours_s=output_sun_hours_summer_2,
    requested_sun_hours_w=requested_sun_hours_winter_2,
    output_sun_hours_w=output_sun_hours_winter_2,
    has_excess_area=it_has_excess_area,
    windows_exported=are_the_windows_being_exported,
    entrance_door_exported=is_the_entrance_door_being_exported,
    interior_door_exported=are_the_interior_doors_being_exported,
    exterior_walls_exported=are_the_exterior_walls_being_exported,
    interior_walls_exported=are_the_interior_walls_being_exported,
    door_connecting_problem=door_connecting_problem)  # -> out, a; inputs requested_rooms: list, output_rooms: list, requested_windows: list, output_windows: list, requested_noise_level: list, output_noise_level: list, requested_sun_hours_s: list, output_sun_hours_s: list, requested_sun_hours_w: list, output_sun_hours_w: list
# ---------- python_3_script_13: Python ----------
import ghpythonlib.treehelpers as th
import json
import os
import re

path = save_path


floorplan_data = {
    "layout_option": layout_option,
    "requested_area": requested_area,
    "final_area": final_area,
    "requested_rooms": requested_rooms,
    "output_rooms": output_rooms,
    "requested_windows": requested_windows,
    "output_windows": output_windows,
    "requested_noise_level": requested_noise_level,
    "output_noise_level": output_noise_level,
    "requested_sun_hours_s": requested_sun_hours_s,
    "output_sun_hours_s": output_sun_hours_s,
    "requested_sun_hours_w": requested_sun_hours_w,
    "output_sun_hours_w": output_sun_hours_w,
    "has_excess_area": has_excess_area,
    "windows_exported": windows_exported,
    "entrance_door_exported": entrance_door_exported,
    "interior_door_exported": interior_door_exported,
    "exterior_walls_exported": exterior_walls_exported,
    "interior_walls_exported": interior_walls_exported,
    "door_connecting_problem": door_connecting_problem,
}
out_floorplan_data  = floorplan_data

with open(path, "w") as json_file:
    json.dump(floorplan_data, json_file, indent=4)
# ---------- end python_3_script_13 ----------
