# Grasshopper definition llm_requests.gh (Grasshopper 1.0.8)
# plug-ins: RhinoCodePluginGH

panel = Panel("i need an apartment where i can cook and work beside sleeping. also, the kitchen should connect to the office and the bathroom")
py3 = Python3Script(input_text=panel, run=Toggle(True))  # -> out, out_2
# ---------- py3: Python ----------
import requests

url = 'http://localhost:5000/get_parameters'
payload = {'input': input_text}

out = None
if run:
    try:
        response = requests.post(url, json=payload)
        response.raise_for_status()
        
        # Debug prints
        print("Raw response:", response.text)
        data = response.json()
        print("Parsed JSON:", data)
        print("Response data:", data['response'])
        
        out = str(data['response'])
    except requests.exceptions.RequestException as e:
        out = f"Failed to connect: {str(e)}"

a = out
# ---------- end py3 ----------
panel_2 = Panel(py3.out_2)
py3_2 = Python3Script(llm_json=py3.out_2)  # -> out, room_names, room_areas, room_connections
# ---------- py3_2: Python ----------
import ast

# Step 1: Convert the string to a Python dictionary
llm_dict = ast.literal_eval(llm_json)

# Step 2: Now access the data safely
rooms = llm_dict['rooms']

room_names = []
room_areas = []
room_connections = set()

for room in rooms:
    room_type = room['type']
    room_area = room['area']
    connects_to = room['connects_to']  # Already a list now

    room_names.append(room_type)
    room_areas.append(room_area)

    for target in connects_to:
        # Avoid duplicates like A-B and B-A by sorting
        pair = tuple(sorted([room_type, target]))
        connection = f"{pair[0]}-{pair[1]}"
        room_connections.add(connection)

# Step 3: Output the results to Grasshopper
room_connections = sorted(room_connections)  # Sorted list of unique connections
# ---------- end py3_2 ----------
panel_3 = Panel(py3_2.room_areas)
panel_4 = Panel(py3_2.room_names)
panel_5 = Panel(py3_2.room_connections)
